# Grasshopper definition Flag_2.gh (Grasshopper 1.0.7)
# plug-ins: Kangaroo2 Components

pt = ConstructPoint(XCoordinate=0, YCoordinate=0, ZCoordinate=0)
wind_force_magnitude_0_1_to_0_5 = GetNumber(Slider(0.13, range=0..1), AtLeast=1, AtMost=1, Maximum=1.797693135e+308, Minimum=-1.797693135e+308)
flag_anchor_point = GetPoint(pt, AtLeast=1, AtMost=1, Realtime=True)
true_or_false = GetBoolean(Toggle(True), AtLeast=1, AtMost=1, FalseValue="False", TrueValue="True")
number_slider = Slider(5, range=0..10)
yz = YZPlane(Origin=flag_anchor_point)
rectangle = Rectangle(Plane=yz, XSize=number_slider, YSize=number_slider, Radius=0)  # -> Rectangle, Length
mplane = MeshPlane(Boundary=rectangle.Rectangle, WidthCount=15, HeightCount=10)  # -> Mesh, Area
vec = Vector(Vector(19, 17, 0))
tri = Triangulate(Mesh=mplane.Mesh)  # -> Mesh, Count
medges = MeshEdges(Mesh=tri.Mesh)  # -> NakedEdges, InteriorEdges, NonManifoldEdges
multiplication = Multiplication(A=vec, B=wind_force_magnitude_0_1_to_0_5)
smooth = Smooth(M=tri.Mesh, Strength=1)
show = Show(G=mplane.Mesh)
length_line = LengthLine(Line=[medges.NakedEdges, medges.InteriorEdges], Strength=10)
anchor = Anchor(Point=flag_anchor_point, Strength=10000)
wind = Wind(Mesh=tri.Mesh, WindVector=multiplication)
zombiesolver = ZombieSolver(Threshold=1e-10, Tolerance=0.0001, MaxIterations=50000)  # -> I, V, O
bouncysolver = BouncySolver(
    GoalObjects=[length_line, show, wind, smooth, anchor],
    Reset=Button(),
    Threshold=1e-15,
    Tolerance=0.01,
    Damping=0.99,
    Iterations=2,
    On=true_or_false)  # -> I, V, O
data = Data(bouncysolver.O)
context_bake = ContextBake(Geometry=data)
