# Grasshopper definition Assignment1_Flag.gh (Grasshopper 1.0.7)
# plug-ins: Kangaroo2 Components

pt = ConstructPoint(XCoordinate=0, YCoordinate=0, ZCoordinate=0)
wind_force_magnitude_0_1_to_1_0 = GetNumber(
    Slider(0.179, range=0..1),
    AtLeast=1,
    AtMost=1,
    Maximum=1,
    Minimum=-1.797693135e+308,
    Prompt="Magnitude between 0.1 and 1.0")
flag_anchor_point = GetPoint(pt, AtLeast=1, AtMost=1, Prompt="Pick a point", Realtime=True)
number_slider = Slider(5, range=0..10)
yz = YZPlane(Origin=flag_anchor_point)
rectangle = Rectangle(Plane=yz, XSize=number_slider, YSize=number_slider, Radius=0)  # -> Rectangle, Length
mplane = MeshPlane(Boundary=rectangle.Rectangle, WidthCount=15, HeightCount=10)  # -> Mesh, Area
vec = Vector(Vector(19, 17, 0))
tri = Triangulate(Mesh=mplane.Mesh)  # -> Mesh, Count
medges = MeshEdges(Mesh=tri.Mesh)  # -> NakedEdges, InteriorEdges, NonManifoldEdges
multiplication = Multiplication(A=vec, B=wind_force_magnitude_0_1_to_1_0)
smooth = Smooth(M=tri.Mesh, Strength=1)
show = Show(G=mplane.Mesh)
length_line = LengthLine(Line=[medges.NakedEdges, medges.InteriorEdges], Strength=10)
anchor = Anchor(Point=flag_anchor_point, Strength=10000)
wind = Wind(Mesh=tri.Mesh, WindVector=multiplication)
zombiesolver = ZombieSolver(GoalObjects=[length_line, show, wind, smooth, anchor], Threshold=1e-10, Tolerance=0.0001, MaxIterations=50000)  # -> I, V, O
data = Data(zombiesolver.O)
context_bake = ContextBake(Geometry=data)
