# Grasshopper definition Flag.gh (Grasshopper 1.0.7)
# plug-ins: Kangaroo2 Components

pt = Point([Point(5, 0, 15), Point(5, 0, 5)])
wind_force_magnitude = GetNumber(Slider(0.13, range=0..1), AtLeast=1, AtMost=2147483647, Maximum=0.5, Minimum=0.1)
flag_anchor_points = GetPoint(pt, AtLeast=1, AtMost=2, Realtime=True)
mplane = MeshPlane(Boundary={Plane=PlaneXZ(5, 0, 5), Size=Domain2(u=0..15, v=0..10)}, WidthCount=15, HeightCount=10)  # -> Mesh, Area
anchor = Anchor(Point=flag_anchor_points, Strength=10000)
tri = Triangulate(Mesh=mplane.Mesh)  # -> Mesh, Count
vec = Vector(Vector(19, 17, 0))
multiplication = Multiplication(A=vec, B=wind_force_magnitude)
medges = MeshEdges(Mesh=tri.Mesh)  # -> NakedEdges, InteriorEdges, NonManifoldEdges
smooth = Smooth(M=tri.Mesh, Strength=1)
show = Show(G=mplane.Mesh)
length_line = LengthLine(Line=[medges.NakedEdges, medges.InteriorEdges], Strength=10)
wind = Wind(Mesh=tri.Mesh, WindVector=multiplication)
zombiesolver = ZombieSolver(GoalObjects=[length_line, show, anchor, wind, smooth], Threshold=1e-10, Tolerance=0.0001, MaxIterations=50000)  # -> I, V, O
bouncysolver = BouncySolver(Reset=Button(), Threshold=1e-15, Tolerance=0.01, Damping=0.99, Iterations=2, On=Toggle(True))  # -> I, V, O
clean = CombineClean(Meshes=zombiesolver.O)

# ---- group: RH_OUT: Flag
subd = SubD(clean)

# ----
context_bake = ContextBake(Geometry=subd)
