# Grasshopper definition Flag_4.gh (Grasshopper 1.0.7)
# plug-ins: Kangaroo2 Components

pt = ConstructPoint(XCoordinate=0, YCoordinate=0, ZCoordinate=0)
pt_2 = ConstructPoint(XCoordinate=0, YCoordinate="15", ZCoordinate="15")
merge = Merge(Data1=pt, Data2=pt_2)
wind_force_magnitude_0_1_to_5_0 = GetNumber(Slider(0.222, range=0..1), AtLeast=1, AtMost=1, Maximum=5, Minimum=-1.797693135e+308)
flag_anchor_2_points = GetPoint(merge, AtLeast=1, AtMost=2, Realtime=True)
true_or_false = GetBoolean(Toggle(True), AtLeast=1, AtMost=1, FalseValue="False", TrueValue="True")
yz = YZPlane(Origin=pt)
rec_2pt = Rectangle2Pt(Plane=yz, PointA=pt, PointB=pt_2, Radius=0)  # -> Rectangle, Length
mplane = MeshPlane(Boundary=rec_2pt.Rectangle, WidthCount=15, HeightCount=10)  # -> Mesh, Area
vec = Vector(Vector(19, 17, 0))
tri = Triangulate(Mesh=mplane.Mesh)  # -> Mesh, Count
medges = MeshEdges(Mesh=tri.Mesh)  # -> NakedEdges, InteriorEdges, NonManifoldEdges
multiplication = Multiplication(A=vec, B=wind_force_magnitude_0_1_to_5_0)
smooth = Smooth(M=tri.Mesh, Strength=1)
show = Show(G=mplane.Mesh)
length_line = LengthLine(Line=[medges.NakedEdges, medges.InteriorEdges], Strength=10)
anchor = Anchor(Point=flag_anchor_2_points, Strength=10000)
wind = Wind(Mesh=tri.Mesh, WindVector=multiplication)
bouncysolver = BouncySolver(
    GoalObjects=[length_line, show, wind, smooth, anchor],
    Reset=Button(),
    Threshold=1e-15,
    Tolerance=0.01,
    Damping=0.99,
    Iterations=2,
    On=true_or_false)  # -> I, V, O
data = Data(bouncysolver.O)
context_bake = ContextBake(Geometry=data)
