# Grasshopper definition Spikey_Final.gh (Grasshopper 1.0.7)
# Spherical spikey thing

cell_radius = Slider(10, range=0..10)
branch_length = Slider(10, range=0..10)
pt = ConstructPoint(XCoordinate=0, YCoordinate=0, ZCoordinate=0)
get_point = GetPoint(pt, AtLeast=1, AtMost=1, Realtime=True)
radius = GetNumber(cell_radius, AtLeast=1, AtMost=1, Maximum=20, Minimum=-1.797693135e+308, Prompt="Base radius")
count = GetInteger(Slider(100, range=1..100), AtLeast=1, AtMost=1, Maximum=300, Minimum=-2147483648, Prompt="Number of spikes")
length = GetNumber(branch_length, AtLeast=1, AtMost=1, Maximum=50, Minimum=-1.797693135e+308, Prompt="Spike length")
msphere = MeshSphere(Base=get_point, Radius=radius, UCount=10, VCount=20)
popgeo = PopulateGeometry(Geometry=msphere, Count=count, Seed=1)
facet = FacetDome(Points=popgeo, Radius=radius)  # -> Pattern, Dome
explode = Explode(Curve=facet.Pattern, Recursive=True)  # -> Segments, Vertices
curvepoint = PointOnCurve(explode.Segments, parameter=0.5)
avr = Average(Input=curvepoint)
lng = ListLength(List=explode.Segments)
vec2pt = Vector2Pt(PointA=get_point, PointB=avr, Unitize=invert(False))  # -> Vector, Length
amp = Amplitude(Vector=vec2pt.Vector, Amplitude=length)
addition = Addition(A=avr, B=amp)
end = EndPoints(Curve=graft(explode.Segments))  # -> Start, End
dup = DuplicateData(Data=addition, Number=lng, Order=True)
pshift = ShiftPaths(Data=dup, Offset=-1)  # -> graft(Data)
merge = Merge(Data1=end.Start, Data2=end.End, Data3=pshift)
triangle = MeshTriangle(CornerA=0, CornerB=1, CornerC=2)
conmesh = ConstructMesh(Vertices=merge, Faces=triangle)
mjoin = MeshJoin(Meshes=flatten(conmesh))
alignvert = AlignVertices(Mesh=mjoin, Tolerance=0.1)  # -> Result, Count
weld = WeldMesh(Mesh=alignvert.Result, Angle=3.141592654)
subdmesh = SubDFromMesh(Mesh=weld, Creases=1, Corners=1, Interpolate=False)

# ---- group: RH_OUT:SubD
subd = SubD(subdmesh)

# ----
context_bake = ContextBake(Geometry=subd)
